# Grasshopper definition MainFile.gh (Grasshopper 1.0.7)
# plug-ins: BH.UI.Grasshopper, Human, Hops

getinfo = GetInfo(Component="{ .GetInfo")
# <Script name>
project_number = Panel("")
setprojectid = SetProjectID(ProjectID=project_number, Component="{ .SetProjectID")
bhom_version_used_to_create = Panel("7.1")
bhom_version_currently_installed = Panel(getinfo)

# ---- group: 1.0 Define Context / Waypoints
crv = Curve(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)
divide = DivideCurve(Curve=crv, Count=Slider(4, range=0..10), Kinks=False)  # -> Points, Tangents, Parameters

# ---- group: 1.0 Define Context / Boundary
panel = Panel("200")
merge = Merge(Data1="0", Data2=panel)

# ---- group: 1.0 Define Context
crv_2 = Curve(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)
explode = Explode(Curve=crv_2, Recursive=True)  # -> Segments, Vertices

# ---- group: 1.0 Define Context / Obstacle
crv_3 = Curve([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])

# ---- group: 1.0 Define Context
explode_2 = Explode(Curve=crv_3, Recursive=True)  # -> Segments, simplify(Vertices)

# 01
# CREATE
# CONTEXT
panel_2 = Panel("test")
python = GhPythonScript(
    versionInp="1.1",
    nameInp=panel_2,
    x_marginInp=merge,
    y_marginInp=merge,
    ped_routesInp=divide.Points,
    crowded_zonesInp=explode.Vertices,
    obstaclesInp=explode_2.Vertices,
    Run=Toggle(False))  # -> out, a; inputs x_marginInp: list of Int32, y_marginInp: list of Int32, ped_routesInp: list of Point3d, crowded_zonesInp: list of Point3d, obstaclesInp: tree of Point3d, Run: Boolean
# ---------- python: Python ----------
__author__ = "ebendo"
__version__ = "2024.04.17"

import rhinoscriptsyntax as rs
import json
from collections import OrderedDict
import ghpythonlib.treehelpers as th



def GetVertexCoord(rhinoPoints, last):
    points=[]
    for i in range(len(rhinoPoints)):
        point=[]
        point.append(int(rhinoPoints[i][0]))
        point.append(int(y_marginInp[1] - rhinoPoints[i][1])) #because the coordinate system is different
        points.extend([point])
    if(last):# I dont want to remove the last vertice in the case of waypoints
        points.pop()
    return points

def createObstacles(obstaclesInp):
    obstaclesJson=[]
    for i in range(obstaclesInp.BranchCount):
        obstacleTemp = OrderedDict()
        obstacleTemp["name"]="zone {0}".format(i)
        obstacleTemp["vertices"]= GetVertexCoord(obstaclesInp.Branch(i), True)
        print(obstacleTemp)
        obstaclesJson.append(obstacleTemp)
    return obstaclesJson

waypoints=GetVertexCoord(ped_routesInp, False)
crowded_zones=GetVertexCoord(crowded_zonesInp, True)
crowded_zones.pop() #rectangles in the library are only defined by the first 3 vertices
obstacles=createObstacles(obstaclesInp)

def create_json(version, name, x_margin, y_margin, waypoints, crowded_zones, obstacles):
    json_data = OrderedDict()
    json_data["version"] = version
    json_data["name"] = name
    json_data["bounds"] = OrderedDict()
    json_data["bounds"]["x_margin"] = x_margin
    json_data["bounds"]["y_margin"] = y_margin
    
    ped_routes = [
    OrderedDict({
        "name": "route_1",
        "waypoints": waypoints,
        "reversible": True
        })
    ]
    crowded_zones = [
        OrderedDict({
            "name": "zone_1",
            "zone_rect": crowded_zones
        })
    ]
    json_data["ped_routes"] = ped_routes
    json_data["crowded_zones"] = crowded_zones
    json_data["obstacles"] = obstacles
    return json.dumps(json_data, indent=4)

print(y_marginInp[1])
# Generate JSON
if(Run):
    output_json = create_json(versionInp, nameInp, x_marginInp, y_marginInp, waypoints, crowded_zones, obstacles)
    a=output_json
    # Save JSON to file
    file_path = "C:\Users\ebendo\Documents\GitHub\PySocialForce\maps\GHMap.json"  # Define the file path where you want to save the JSON
    with open(file_path, "w") as f:
        f.write(output_json)
    
    print("JSON saved to", file_path)
# ---------- end python ----------

# ----
panel_3 = Panel(python.a)
panel_4 = Panel(python.out)

# ---- group: Get Starting Points
# 02
# SET
# PEDESTRIAN
# LOCATIONS
rec = Rectangle({Plane=PlaneXY(32.68649661, 35.50617937, 0), Size=Domain2(u=-13.05477995..13.05477995, v=-12.57126958..12.57126958)})  # disabled
pop2d = Populate2D(Region=rec, Count=100, Seed=1)  # disabled
pt = Point([Point(59.78373769, 35.65805689, 0), Point(52.86859988, 38.67234773, 0), Point(25.91729354, 52.1480009, 0), Point(36.20134464, 63.49591936, 0), Point(46.66270697, 64.73709794, 0), Point(45.95346207, 79.80855215, 0), Point(20.77526799, 68.81525614, 0)])
python_2 = GhPythonScript(Points=pt, write=Toggle(False), y_margin=merge)  # -> out, a; inputs Points: list of Point3d, write: Boolean, y_margin: list of Int32
# ---------- python_2: Python ----------
__author__ = "ebendo"
__version__ = "2024.05.15"

import rhinoscriptsyntax as rs
import json
from collections import OrderedDict

point_data = []
for i in range(len(Points)):
    point_dict = OrderedDict()
    point_dict["x"]=round(Points[i][0],2)
    point_dict["y"]=y_margin[1]-round(Points[i][1],2)#200 because of boundary
    
    point_data.append(point_dict)

if(write):
    json_data = json.dumps(point_data, indent=4)

    # Save JSON to file
    file_path = "C:\Users\ebendo\Documents\GitHub\PySocialForce\maps\peds.json"
    with open(file_path, "w") as f:
        f.write(json_data)
    print("JSON saved to", file_path)
# ---------- end python_2 ----------

# ----
panel_5 = Panel(python_2.out)

# ---- group: PLAY
number_slider = Slider(920, range=0..10000)

# ----
number_slider_2 = Slider(0, range=0..5000)
crv_4 = Curve(Tree({0;0}: [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], {1;0}: [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], {2;0}: [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], {3;0}: [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], {4;0}: [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], {5;0}: [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]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))
crv_5 = Curve(Tree({0;0}: [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], {1;0}: [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], {2;0}: [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], {3;0}: [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], {4;0}: [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], {5;0}: [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]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))

# ----
# 03
# SIMULATE
number_slider_3 = Slider(100, range=0..100)
number_slider_4 = Slider(1000, range=0..10000)
number_slider_5 = Slider(1800, range=0..10000)
number_slider_6 = Slider(10, range=0..10)

hops = Hops(
    Step=number_slider_4,
    Simulate=Toggle(True),
    CacheResultsInMemory=False,
    CacheSolveResults=False,
    RemoteDefinitionLocation="http://127.0.0.1:5000/simulate",
    RemoteSolveVersion=(0, 1, 0),
    ShowInput_Enabled=False,
    ShowInput_Path=False,
    SynchronousSolve=True)

pt_2 = Point(hops)

subtraction = Subtraction(A=number_slider_4, B=number_slider)

lng = ListLength(List=pt_2)
division = Division(A=lng, B=number_slider_4)
partition = PartitionList(List=pt_2, Size=division)  # -> simplify(Chunks)
flip = FlipMatrix(Data=partition)
shift = ShiftList(List=reverse(flip), Shift=subtraction, Wrap=False)
pline = PolyLine(Vertices=shift, Closed=False)

branch = TreeBranch(Tree=partition, Path=number_slider, MaintainPaths=True)

# ---- group: DISPLAY
number_slider_7 = Slider(1, range=0..10)
cir = Circle(Plane=branch, Radius=number_slider_7)
cir_2 = Circle(Plane=pt, Radius=number_slider_7)
rectangle = Rectangle(Plane=PlaneXY(0, 0, 0), XSize=panel, YSize=panel, Radius=0)  # -> Rectangle, Length
boundary = BoundarySurfaces(Edges=crv_2)
boundary_2 = BoundarySurfaces(Edges=crv_3)
number_slider_8 = Slider(0.3, range=0..1)
boundary_3 = BoundarySurfaces(Edges=cir)
boundary_4 = BoundarySurfaces(Edges=cir_2)
swatch = ColourSwatch(SwatchColor=RGB(36, 27, 255))
previewmat = CustomPreviewMaterials(Geometry=boundary_4, DiffuseColor=swatch, Transparency=number_slider_8)
previewlw = CustomPreviewLineweights(
    Geometry=rectangle.Rectangle,
    Shader=ColourSwatch(SwatchColor=RGB(0, 0, 0)),
    Thickness=Slider(1, range=0..1),
    Absolute=False)
previewmat_2 = CustomPreviewMaterials(Geometry=boundary_3, DiffuseColor=swatch, Transparency=number_slider_8)
previewmat_3 = CustomPreviewMaterials(Geometry=boundary, DiffuseColor=RGB(255, 255, 255), Transparency=Slider(0.4, range=0..1))
previewmat_4 = CustomPreviewMaterials(Geometry=boundary_2, DiffuseColor=ColourSwatch(SwatchColor=RGB(113, 157, 181)))
previewlw_2 = CustomPreviewLineweights(Geometry=pline, Shader=ColourSwatch(SwatchColor=RGB(104, 127, 225)), Absolute=False)

# ----
pt_3 = Point(branch)
